# Grasshopper definition ghPython_A4D_EE_001c.gh (Grasshopper 1.0.7)
# Copyright: © 2017-2018 Pierre Cuvilliers, Caitlin Mueller, Massachusetts Institute of Technology

number_slider = Slider(3, range=0..10)
# Grid Points
number_slider_2 = Slider(1.723, range=0..10)
number_slider_3 = Slider(3, range=0..10)

# ----
# NumPy Array
# Perform Basic Math Functions on Vectors and Matricies
number_slider_4 = Slider(2, range=0..10)
numpy_array = GhPythonScript(rows=number_slider, columns=number_slider_3)  # -> out, myMatrixOut; inputs rows: Int32, columns: Int32
# ---------- numpy_array: Python ----------
import rhinoscriptsyntax as rs
import scriptcontext as sc
import ghpythonremote
from ghpythonlib.treehelpers import list_to_tree #rhino 6,7 only!
np = sc.sticky['numpy']
rpy = sc.sticky['rpy']

myVect = np.arange(rows * columns).reshape((rows,columns))
print(myVect)
print(type(myVect[0]))

myMatrixOut = myVect
myMatrixOut = ghpythonremote.obtain(myMatrixOut.tolist())
myMatrixOut = list_to_tree(myMatrixOut, source=[0,0])
# ---------- end numpy_array ----------
numpyarrayaddition = GhPythonScript(addition=number_slider_4, rows=number_slider, columns=number_slider_3)  # -> out, myMatrixOut; inputs rows: Int32, columns: Int32
# ---------- numpyarrayaddition: Python ----------
import rhinoscriptsyntax as rs
import scriptcontext as sc
import ghpythonremote
from ghpythonlib.treehelpers import list_to_tree #rhino 6,7 only!
np = sc.sticky['numpy']
rpy = sc.sticky['rpy']

myVect = np.arange(rows * columns).reshape((rows,columns))
print(myVect)
print(type(myVect[0]))

myMatrixOut = myVect + addition
print type(myMatrixOut)

myMatrixOut = ghpythonremote.obtain(myMatrixOut.tolist())
print type(myMatrixOut)

myMatrixOut = list_to_tree(myMatrixOut, source=[0,0])
print type(myMatrixOut)
# ---------- end numpyarrayaddition ----------
panel = Panel(numpyarrayaddition.out)
panel_2 = Panel(numpyarrayaddition.myMatrixOut)
panel_3 = Panel(numpy_array.myMatrixOut)
panel_4 = Panel(numpy_array.out)

negative = Negative(Value="3")
square = Square(Plane=PlaneXY(0, 0, 0), Size=number_slider_2, ExtentX=expr("x-1", number_slider), ExtentY=expr("x-1", number_slider_3))  # -> Cells, Points
# Getting ghpython Remote component up and running.
# ALGORITHMS for Dummies TRANSLATED IN TO GRASSHOPPER FOR RHINO3D, Chapter 4: Performing Calculations Using Vectors and Matrices
# The goal of mathematical algorithms is to turn one kind of data into another kind of data.\
# 
# Time to learn how to create your own library  of hand-coded algorithms.
# 
# Discover how to speed up the calculations so that you spend less time manipulating
# the date and more time doing something really interesting with it.
# Performing Calculations Using Vectors and Matrices
# 
# Scalar i..e. 2
# Vector i.e. a list of numbers [2,3,4] one dimensional array
# Matrix i.e. rows of lists
#  [[2,3,4],
#   [5,6,7],
#   [8,9,0]]
# NumPy package (http://numpy.org/)
# 
# import numpy as np
# i.e.
# myShort = np.short(15)
# #a value that is 16 bits long
# Let's have a look at numpy array() in the grasshopper canvas and the ghpython remote component.
panel_5 = Panel("C:\Users\Sculpture\anaconda3\envs\rhinoremote")
construct_point = ConstructPoint(XCoordinate="3", YCoordinate="3", ZCoordinate=0)
# Triangle: C
# Angle: D
construct_point_2 = ConstructPoint(XCoordinate=negative, YCoordinate="3", ZCoordinate=0)

# ----
# Perform Basic Math Functions on Vectors and Matricies
number_slider_5 = Slider(2, range=0..10)
ghpython_script = GhPythonScript(rows=Slider(3, range=0..10), columns=Slider(2, range=0..10))  # -> out, myMatrixOut; inputs rows: Int32, columns: Int32; same code as numpy_array
ghpython_script_2 = GhPythonScript(addition=Slider(4, range=0..10), rows=Slider(3, range=0..10), columns=number_slider_5)  # -> out, myMatrixOut; inputs rows: Int32, columns: Int32; same code as numpyarrayaddition
panel_6 = Panel(ghpython_script.out)
panel_7 = Panel(ghpython_script.myMatrixOut)
panel_8 = Panel(ghpython_script_2.out)
panel_9 = Panel(ghpython_script_2.myMatrixOut)

# ----
# Euclid's Elements
# Book 1: Proposition 44
# To apply a parallelogram equal to a given triange to a given straight-line in a given rectilinear angle.
number_slider_6 = Slider(2, range=0..10)
# ALGORITHMS for Dummies meets Euclid's Elements
# NumPy Array
number_slider_7 = Slider(3, range=0..10)
panel_10 = Panel(square.Points)
construct_plane = ConstructPlane(Origin=construct_point, XAxis=Vector(1, 0, 0), YAxis=Vector(0, 1, 0))
# Straight Line: A
construct_plane_2 = ConstructPlane(Origin=Point(0, 0, 0), XAxis=Vector(1, 0, 0), YAxis=Vector(0, 1, 0))
construct_plane_3 = ConstructPlane(Origin=construct_point_2, XAxis=Vector(1, 0, 0), YAxis=Vector(0, 1, 0))
gh_python_remote = GHPythonRemote(location=panel_5, run=Toggle(True), modules="numpy")  # -> out, linked_modules, rpy, import_statements
number_slider_8 = Slider(0.845, range=0..1)
number_slider_9 = Slider(0.063, range=0..1)
number_slider_10 = Slider(0.288, range=0..1)
numpy_array_2 = GhPythonScript(rows=number_slider_7, columns=number_slider_6)  # -> out, myMatrixOut; inputs rows: Int32, columns: Int32; same code as numpy_array
ghpython_script_3 = GhPythonScript()  # -> Out, A
ghpython_script_4 = GhPythonScript()  # -> out, a, b, c
# ---------- ghpython_script_4: Python ----------
import rhinoscriptsyntax as rs
import scriptcontext as sc
import ghpythonremote
import random
from ghpythonlib.treehelpers import list_to_tree #rhino 6,7 only!
np = sc.sticky['numpy']
rpy = sc.sticky['rpy']

a = np.array([1,2,3,4])
b = np.array([2,2,4,4])

c = (a == b)
print(c)
print(type(c))

a = np.array([1,2,3,4])
a = ghpythonremote.obtain(a.tolist())
a = list_to_tree(a, source=[0,0])

b = np.array([2,2,4,4])
b = ghpythonremote.obtain(b.tolist())
b = list_to_tree(b, source=[0,0])

c = ghpythonremote.obtain(c.tolist())
c = list_to_tree(c, source=[0,0])
# ---------- end ghpython_script_4 ----------
ghpython_script_5 = GhPythonScript(start=Slider(1, range=0..10), end=Slider(10, range=0..10), step=Slider(2, range=0..10))  # -> out, myVectOut; inputs start: Int32, end: Int32, step: Int32
# ---------- ghpython_script_5: Python ----------
__author__ = "Sculpture"
__version__ = "2022.06.02"

import rhinoscriptsyntax as rs
import scriptcontext as sc
import ghpythonremote
from ghpythonlib.treehelpers import list_to_tree #rhino 6,7 only!
np = sc.sticky['numpy']
rpy = sc.sticky['rpy']

myVect = np.arange(start, end, step)
print(myVect)
print(type(myVect[0]))

myVect = np.int16(myVect)
print(myVect)
print(type(myVect[0]))

myVectOut = myVect
myVectOut = ghpythonremote.obtain(myVectOut.tolist())
myVectOut = list_to_tree(myVectOut, source=[0,0])
# ---------- end ghpython_script_5 ----------
ghpython_script_6 = GhPythonScript(a=Slider(2, range=0..10), b=Slider(4, range=0..10), c=Slider(6, range=0..10), d=Slider(8, range=0..10))  # -> out, myVectOut; inputs a: Int32, b: Int32, c: Int32, d: Int32
# ---------- ghpython_script_6: Python ----------
__author__ = "Sculpture"
__version__ = "2022.06.02"

import rhinoscriptsyntax as rs
import scriptcontext as sc
import ghpythonremote
# Grasshopper does not recognize remote list objects as list:
from ghpythonlib.treehelpers import list_to_tree #rhino 6,7 only!
np = sc.sticky['numpy']
rpy = sc.sticky['rpy']

myVect = np.array([a,b,c,d])
print(myVect)
print(type(myVect))

myVectOut = myVect
# They need to be recovered to the local interpreter first:
myVectOut = ghpythonremote.obtain(myVectOut.tolist())
print(type(myVectOut))
myVectOut = list_to_tree(myVectOut, source=[0,0])
print(type(myVectOut))
# ---------- end ghpython_script_6 ----------
circle = Circle(Plane=construct_plane, Radius=1)
circle_2 = Circle(Plane=construct_plane_2, Radius=1)
circle_3 = Circle(Plane=construct_plane_3, Radius=1)
panel_11 = Panel(ghpython_script_4.out)
panel_12 = Panel(ghpython_script_4.a)
panel_13 = Panel(gh_python_remote.import_statements)
panel_14 = Panel(ghpython_script_4.b)
panel_15 = Panel(ghpython_script_4.c)
panel_16 = Panel(ghpython_script_6.out)
pi = Pi(Factor=Slider(12, range=0..12))
panel_17 = Panel(ghpython_script_6.myVectOut)
panel_18 = Panel(ghpython_script_5.myVectOut)
panel_19 = Panel(ghpython_script_5.out)
evaluate_curve = EvaluateCurve(Curve=reparameterize(circle), Parameter=[number_slider_8, number_slider_9, number_slider_10])  # -> Point, Tangent, Angle
panel_20 = Panel(numpy_array_2.out)
panel_21 = Panel(numpy_array_2.myMatrixOut)
evaluate_curve_2 = EvaluateCurve(Curve=reparameterize(circle_2), Parameter=[Slider(0.127, range=0..1), Slider(0.846, range=0..1)])  # -> Point, Tangent, Angle
evaluate_curve_3 = EvaluateCurve(Curve=reparameterize(circle_3), Parameter=[number_slider_8, number_slider_9, number_slider_10])  # -> Point, Tangent, Angle
division = Division(A=pi, B=numpyarrayaddition.myMatrixOut)
data = Data(numpy_array.myMatrixOut)
explode_tree = ExplodeTree(Data=graft(evaluate_curve.Point))  # -> Branch0, Branch1, Branch2
explode_tree_2 = ExplodeTree(Data=graft(evaluate_curve_2.Point))  # -> Branch0, Branch1
explode_tree_3 = ExplodeTree(Data=graft(evaluate_curve_3.Point))  # -> Branch0, Branch1, Branch2
vector_xyz = VectorXYZ(XComponent=0, YComponent=0, ZComponent=graft(data))  # -> Vector, Length
vector_2pt = Vector2Pt(PointA=explode_tree.Branch0, PointB=explode_tree.Branch2, Unitize=False)  # -> Vector, Length
vector_2pt_2 = Vector2Pt(PointA=explode_tree.Branch0, PointB=explode_tree.Branch1, Unitize=explode_tree.Branch0)  # -> Vector, Length
unit_y = UnitY(Factor=1)
line = Line(StartPoint=explode_tree.Branch0, EndPoint=explode_tree.Branch2)
line_2 = Line(StartPoint=explode_tree.Branch0, EndPoint=explode_tree.Branch1)
line_3 = Line(StartPoint=explode_tree_2.Branch0, EndPoint=explode_tree_2.Branch1)
vector_2pt_3 = Vector2Pt(PointA=explode_tree_2.Branch1, PointB=explode_tree_2.Branch0, Unitize=False)  # -> Vector, Length
line_4 = Line(StartPoint=explode_tree_3.Branch1, EndPoint=explode_tree_3.Branch2)
line_5 = Line(StartPoint=explode_tree_3.Branch0, EndPoint=explode_tree_3.Branch1)
line_6 = Line(StartPoint=explode_tree_3.Branch0, EndPoint=explode_tree_3.Branch2)
end_points = EndPoints(Curve=line_3)  # -> Start, End
ghpython_script_7 = GhPythonScript()  # -> out, a
# ---------- ghpython_script_7: Python ----------
__author__ = "Sculpture"
__version__ = "2022.06.02"

import rhinoscriptsyntax as rs
import scriptcontext as sc
import ghpythonremote
np = sc.sticky['numpy']
rpy = sc.sticky['rpy']

r_range = ghpythonremote.deliver(rpy, range(100))
print(np.array(r_range))
# ---------- end ghpython_script_7 ----------
vector_display = VectorDisplay(Anchor=explode_tree.Branch0, Vector=vector_2pt.Vector)
ghpython_script_8 = GhPythonScript()  # -> out, a
# ---------- ghpython_script_8: Python ----------
__author__ = "Sculpture"
__version__ = "2022.06.02"

import rhinoscriptsyntax as rs
import scriptcontext as sc
import ghpythonremote
from ghpythonlib.treehelpers import list_to_tree #rhino 6,7 only!
np = sc.sticky['numpy']
rpy = sc.sticky['rpy']

r_range = ghpythonremote.deliver(rpy, range(100))
print(np.array(r_range))

a = np.array(r_range)
print(type(a))
a = ghpythonremote.obtain(a.tolist())
a = list_to_tree(a, source=[0,0])
# ---------- end ghpython_script_8 ----------
vector_display_2 = VectorDisplay(Anchor=explode_tree.Branch0, Vector=vector_2pt_2.Vector)
join_curves = JoinCurves(Curves=[line_5, line_6, line_4], Preserve=False)
angle = Angle(VectorA=unit_y, VectorB=vector_2pt_3.Vector)  # -> Angle, Reflex
angle_2 = Angle(VectorA=vector_2pt_2.Vector, VectorB=vector_2pt.Vector)  # -> Angle, Reflex
vector_display_3 = VectorDisplay(Anchor=end_points.End, Vector=vector_2pt_3.Vector)
panel_22 = Panel(ghpython_script_7.out)
panel_23 = Panel(ghpython_script_7.a)
panel_24 = Panel(ghpython_script_8.out)
panel_25 = Panel(ghpython_script_8.a)
boundary_surfaces = BoundarySurfaces(Edges=flatten(join_curves))
panel_26 = Panel(angle.Angle)
degrees = Degrees(Radians=angle_2.Angle)
area = Area(Geometry=boundary_surfaces)  # -> Area, Centroid
panel_27 = Panel(degrees)
text_tag_3d = TextTag3D(Location=explode_tree.Branch0, Text="D", Size=".1", Justification=7)
# Defining advanced matrix operations
# 
# reshape() function that lets you put the data into any shape needed.
# In fact, you can reshape a vector into a matrix.
number_slider_11 = Slider(2, range=0..10)
# Transposition and inverse of a matrix
number_slider_12 = Slider(2, range=0..10)
# linalg.inv() and allclose() to compare the dot()
number_slider_13 = Slider(2, range=0..10)
# Dot product works completely differently with matrixes.
# In this case,
# the number in the matrix a must match the number of rows in matrix b.
# However, the # of rows in a can be any munber,
# and the # of columns in b can be any number.
ghpython_script_9 = GhPythonScript()  # -> out, myMatrix
# ---------- ghpython_script_9: Python ----------
__author__ = "Sculpture"
__version__ = "2022.06.02"

import rhinoscriptsyntax as rs
import scriptcontext as sc
import ghpythonremote
from ghpythonlib.treehelpers import list_to_tree #rhino 6,7 only!
np = sc.sticky['numpy']
rpy = sc.sticky['rpy']

a = np.array([[1,2,3], [4,5,6], [7,8,9]])
b = np.array([[1,2,3], [4,5,6], [7,8,9]])
print(a.dot(b))

myMatrix = (a.dot(b))
myMatrix = ghpythonremote.obtain(myMatrix.tolist())
myMatrix = list_to_tree(myMatrix, source=[0,0])

"""
Dot product works completely differently with matrixes.
In this case,
the number in the matrix a must match the number of rows in matrix b.
However, the # of rows in a can be any munber,
and the # of columns in b can be any number.
"""
# ---------- end ghpython_script_9 ----------
# Performing vector multiplication
# 
# You need to use the dot product, which is the sum of the products of two sequences.
# 
# the dotproduct is always the sum of individual element-by-element multiplications and results in a single number.
# 
# Creating a matrix is the right way to start.
# 
# Simply use the array() function as you would with a vector, but you define additional dimensions.
# 
# rows (one direction)
# columns (second direction)
ghpython_script_10 = GhPythonScript()  # -> out, myMatrix
# ---------- ghpython_script_10: Python ----------
__author__ = "Sculpture"
__version__ = "2022.06.02"

import rhinoscriptsyntax as rs
import scriptcontext as sc
import ghpythonremote
from ghpythonlib.treehelpers import list_to_tree #rhino 6,7 only!
np = sc.sticky['numpy']
rpy = sc.sticky['rpy']

myMatrix = np.array([[1,2,3], [4,5,6], [7,8,9]])
print(myMatrix)
print(type(myMatrix))

myMatrix = ghpythonremote.obtain(myMatrix.tolist())
myMatrix = list_to_tree(myMatrix, source=[0,0])
# ---------- end ghpython_script_10 ----------
ghpython_script_11 = GhPythonScript()  # -> out, myMatrix
# ---------- ghpython_script_11: Python ----------
__author__ = "Sculpture"
__version__ = "2022.06.02"

import rhinoscriptsyntax as rs
import scriptcontext as sc
import ghpythonremote
from ghpythonlib.treehelpers import list_to_tree #rhino 6,7 only!
np = sc.sticky['numpy']
rpy = sc.sticky['rpy']

a = np.array([[1,2,3], [4,5,6], [7,8,9]])
b = np.array([[1,2,3], [4,5,6], [7,8,9]])
print(a + b)

myMatrix = (a + b)
myMatrix = ghpythonremote.obtain(myMatrix.tolist())
myMatrix = list_to_tree(myMatrix, source=[0,0])
# ---------- end ghpython_script_11 ----------
ghpython_script_12 = GhPythonScript(x=number_slider_11, y=Slider(2, range=0..10), z=Slider(2, range=0..10))  # -> out, changeIt; inputs x: Int32, y: Int32, z: Int32
# ---------- ghpython_script_12: Python ----------
import rhinoscriptsyntax as rs
import scriptcontext as sc
import ghpythonremote
from ghpythonlib.treehelpers import list_to_tree #rhino 6,7 only!
np = sc.sticky['numpy']
rpy = sc.sticky['rpy']

changeIt = np.array([1,2,3,4,5,6,7,8])
print(changeIt)

if x*y*z == len(changeIt):
    changeIt = changeIt.reshape(2,2,2)
    print(changeIt)
    changeIt = ghpythonremote.obtain(changeIt.tolist())
    changeIt = list_to_tree(changeIt, source=[0,0])
    
else:
    print("error")
# ---------- end ghpython_script_12 ----------
ghpython_script_13 = GhPythonScript(x=number_slider_12, y=Slider(2, range=0..10), z=number_slider_13)  # -> out, changeIt; inputs x: Int32, y: Int32, z: Int32
# ---------- ghpython_script_13: Python ----------
import rhinoscriptsyntax as rs
import scriptcontext as sc
import ghpythonremote
from ghpythonlib.treehelpers import list_to_tree #rhino 6,7 only!
np = sc.sticky['numpy']
rpy = sc.sticky['rpy']

changeIt = np.array([[1,2,3,4],[5,6,7,8]])
print(changeIt)

changeIt = np.transpose(changeIt)

#Grasshopper list and tree
changeIt = ghpythonremote.obtain(changeIt.tolist())
changeIt = list_to_tree(changeIt, source=[0,0])
print(changeIt)
# ---------- end ghpython_script_13 ----------
ghpython_script_14 = GhPythonScript()  # -> out, a, b, c
# ---------- ghpython_script_14: Python ----------
import rhinoscriptsyntax as rs
import scriptcontext as sc
import ghpythonremote
from ghpythonlib.treehelpers import list_to_tree #rhino 6,7 only!
np = sc.sticky['numpy']
rpy = sc.sticky['rpy']

print(np.identity(5))

a = np.array([[1,2],[3,4]])
b = np.linalg.inv(a)

c = np.allclose(np.dot(a,b), np.identity(2))
print(np.allclose(np.dot(a,b), np.identity(2)))

#Grasshopper list and tree
a = ghpythonremote.obtain(a.tolist())
print(a)
print type(a)
a = list_to_tree(a, source=[0,0])
print type(a)

b = ghpythonremote.obtain(b.tolist())
print(b)
print type(b)
b= list_to_tree(b, source=[0,0])
print type(b)
# ---------- end ghpython_script_14 ----------
panel_28 = Panel(ghpython_script_10.out)
panel_29 = Panel(ghpython_script_11.out)
panel_30 = Panel(ghpython_script_9.out)
vector_2pt_4 = Vector2Pt(PointA=explode_tree_3.Branch0, PointB=explode_tree_3.Branch2, Unitize=False)  # -> Vector, Length
vector_2pt_5 = Vector2Pt(PointA=explode_tree_3.Branch1, PointB=explode_tree_3.Branch2, Unitize=False)  # -> Vector, Length
vector_2pt_6 = Vector2Pt(PointA=explode_tree_3.Branch0, PointB=explode_tree_3.Branch1, Unitize=explode_tree.Branch0)  # -> Vector, Length
panel_31 = Panel(ghpython_script_12.out)
panel_32 = Panel(ghpython_script_12.changeIt)
panel_33 = Panel(ghpython_script_14.out)
panel_34 = Panel(ghpython_script_13.out)
panel_35 = Panel(ghpython_script_13.changeIt)
panel_36 = Panel(ghpython_script_14.a)
panel_37 = Panel(ghpython_script_14.c)
panel_38 = Panel(ghpython_script_11.myMatrix)
panel_39 = Panel(ghpython_script_9.myMatrix)
vector_display_4 = VectorDisplay(Anchor=end_points.Start, Vector=vector_2pt_4.Vector)
vector_display_5 = VectorDisplay(Anchor=end_points.Start, Vector=vector_2pt_6.Vector)
vector_display_6 = VectorDisplay(Anchor=end_points.Start, Vector=vector_2pt_5.Vector)
panel_40 = Panel(ghpython_script_14.b)
text_tag_3d_2 = TextTag3D(Location=end_points.Start, Text="B", Size=".1", Justification=7)
text_tag_3d_3 = TextTag3D(Location=area.Centroid, Text="C", Size=".1", Justification=7)
panel_41 = Panel(ghpython_script_10.myMatrix)
move = Move(Geometry=vector_2pt_3.Vector, Motion=vector_2pt_3.Vector)  # -> Geometry, Transform
panel_42 = Panel(vector_2pt_6.Length)
panel_43 = Panel(vector_2pt_4.Length)
amplitude = Amplitude(Vector=move.Geometry, Amplitude=panel_43)
unit_z = UnitZ(Factor=1)
angle_3 = Angle(VectorA=amplitude, VectorB=vector_2pt_4.Vector)  # -> Angle, Reflex
curve_middle = CurveMiddle(Curve=line_5)
negative_2 = Negative(Value=angle_3.Angle)
vector_2pt_7 = Vector2Pt(PointA=explode_tree_3.Branch0, PointB=curve_middle, Unitize=False)  # -> Vector, Length
# random.sample()
# Facing repetitions
# 
# list(set(a))
number_slider_14 = Slider(4, range=0..10)
# Creating Combinations the Right Way
# 
# Data isn't simply a sequence of numbers__
# it presents a meaningful sequence that,
# when ordered the proper way,
# conveys information to the viewer.
# Permutations, combinations and repetitions.
# 
# Distinguishing permutations
# 
# Creating a data permutation, a reordering of the data so that it presents a different view,
# might help to acheive a desired result.
# 
# numpy random.permutation() function
number_slider_15 = Slider(4, range=0..10)
# Shuffling combinations
# 
# Sometimes you really need just a few of the members in combinations of a specific length.
# 
# combinations()
number_slider_16 = Slider(10, range=0..10)
rotate = Rotate(Vector=vector_2pt_6.Vector, Axis=unit_z, Angle=negative_2)
panel_44 = Panel(vector_2pt_7.Length)
vector_display_7 = VectorDisplay(Anchor=explode_tree_3.Branch0, Vector=vector_2pt_7.Vector)
vector_display_8 = VectorDisplay(Anchor=end_points.Start, Vector=rotate)
vector_display_9 = VectorDisplay(Anchor=end_points.Start, Vector=amplitude)
ghpython_script_15 = GhPythonScript(count=number_slider_14)  # -> out, randOut; inputs count: Int32
# ---------- ghpython_script_15: Python ----------
import rhinoscriptsyntax as rs
import scriptcontext as sc
import ghpythonremote
import random
from ghpythonlib.treehelpers import list_to_tree #rhino 6,7 only!
np = sc.sticky['numpy']
rpy = sc.sticky['rpy']

from itertools import combinations
import random

a = np.array([1,2,3,4])

pool = []

for comb in combinations(a,2):
    print(comb)
    pool.append(comb)

print(randOut)
randOut = (random.sample(pool, count))
# ---------- end ghpython_script_15 ----------
ghpython_script_16 = GhPythonScript(x=number_slider_15, y=Slider(7, range=0..10), z=number_slider_16)  # -> out, a_list; inputs x: Int32, y: Int32, z: Int32
# ---------- ghpython_script_16: Python ----------
__author__ = "Sculpture"
__version__ = "2022.06.02"

import rhinoscriptsyntax as rs
import scriptcontext as sc
import ghpythonremote
from ghpythonlib.treehelpers import list_to_tree #rhino 6,7 only!
np = sc.sticky['numpy']
rpy = sc.sticky['rpy']

from itertools import permutations

a = np.array([x,y,z])

newList = []
a_list = []

for i in range(len(a)):
    newList.append(i)
    
#print newList

for p in permutations(a):
    print(p)
    a_list.append(p)
    #for j in newList:
        #print(p[j])

print(a_list)
print(type(a_list))
# ---------- end ghpython_script_16 ----------
ghpython_script_17 = GhPythonScript()  # -> out, a_list
# ---------- ghpython_script_17: Python ----------
import rhinoscriptsyntax as rs
import scriptcontext as sc
import ghpythonremote
import random
from ghpythonlib.treehelpers import list_to_tree #rhino 6,7 only!
np = sc.sticky['numpy']
rpy = sc.sticky['rpy']

from itertools import combinations

a = np.array([1,2,3,4])

a_list = []

for comb in combinations(a,2):
    print(comb)
    a_list.append(comb)

print(a_list)
print(type(a_list))
# ---------- end ghpython_script_17 ----------
ghpython_script_18 = GhPythonScript()  # -> out, b
# ---------- ghpython_script_18: Python ----------
import rhinoscriptsyntax as rs
import scriptcontext as sc
import ghpythonremote
import random
from ghpythonlib.treehelpers import list_to_tree #rhino 6,7 only!
np = sc.sticky['numpy']
rpy = sc.sticky['rpy']
from itertools import combinations
import random

a = np.array([1,2,3,4,4,5,4,3,2,1,4,6,7,4])

b = np.array(list(set(a)))

print(b)
b = ghpythonremote.obtain(b.tolist())
b = list_to_tree(b, source=[0,0])
# ---------- end ghpython_script_18 ----------
amplitude_2 = Amplitude(Vector=rotate, Amplitude=panel_44)
vector_length = VectorLength(Vector=amplitude_2)
circle_4 = Circle(Plane=end_points.Start, Radius=vector_length)
curve = Curve(line_3)
panel_45 = Panel(ghpython_script_15.out)
panel_46 = Panel(ghpython_script_17.out)
panel_47 = Panel(ghpython_script_17.a_list)
panel_48 = Panel(ghpython_script_16.out)
panel_49 = Panel(ghpython_script_15.randOut)
panel_50 = Panel(ghpython_script_16.a_list)
panel_51 = Panel(ghpython_script_18.out)
panel_52 = Panel(ghpython_script_18.b)
curve_curve = CurveCurve(CurveA=circle_4, CurveB=curve)  # -> Points, ParamsA, ParamsB
move_2 = Move(Geometry=end_points.Start, Motion=amplitude)  # -> Geometry, Transform
move_3 = Move(Geometry=end_points.Start, Motion=amplitude_2)  # -> Geometry, Transform
vector_display_10 = VectorDisplay(Anchor=end_points.Start, Vector=amplitude_2)
move_4 = Move(Geometry=curve_curve.Points, Motion=amplitude_2)  # -> Geometry, Transform
move_5 = Move(Geometry=move_3.Geometry, Motion=amplitude)  # -> Geometry, Transform
line_7 = Line(StartPoint=end_points.Start, EndPoint=curve_curve.Points)
line_8 = Line(StartPoint=move_4.Geometry, EndPoint=curve_curve.Points)
line_9 = Line(StartPoint=move_4.Geometry, EndPoint=move_3.Geometry)
line_10 = Line(StartPoint=move_3.Geometry, EndPoint=end_points.Start)
line_11 = Line(StartPoint=end_points.Start, EndPoint=move_3.Geometry)
line_12 = Line(StartPoint=end_points.Start, EndPoint=move_2.Geometry)
line_13 = Line(StartPoint=move_2.Geometry, EndPoint=move_5.Geometry)
line_14 = Line(StartPoint=move_3.Geometry, EndPoint=move_5.Geometry)
line_15 = Line(StartPoint=move_4.Geometry, EndPoint=end_points.Start)
join_curves_2 = JoinCurves(Curves=[line_11, line_12, line_13, line_14], Preserve=False)
number_slider_17 = Slider(3, range=0..10)
boundary_surfaces_2 = BoundarySurfaces(Edges=join_curves_2)
text_tag_3d_4 = TextTag3D(Location=curve_curve.Points, Text="A", Size=".1", Justification=7)
text_tag_3d_5 = TextTag3D(Location=move_4.Geometry, Text="H", Size=".1", Justification=7)
area_2 = Area(Geometry=boundary_surfaces_2)  # -> Area, Centroid
vector_2pt_8 = Vector2Pt(PointA=move_2.Geometry, PointB=curve_curve.Points, Unitize=False)  # -> Vector, Length
extend_curve = ExtendCurve(Curve=line_15, Type=0, Start="0", End=number_slider_17)
extend_curve_2 = ExtendCurve(Curve=line_13, Type=0, Start=number_slider_17, End="0")
# Explaining Recursion
# In recursion, you call a Python function,
# it does something,
# and then it calls itself repeatedly until it reaches a specific condition-
# but all those previous calls are still active.
# The calls unwind themselves one at a time until the first call finally ends with the correct answer,
# and this unwinding process is where most people encounter a problem.
# The conditions for ending recursion haven't been met,
# so the function must call itself again.
# The conditions for ending recursion have been met,
# so the function returns a final value that is used to calculate the ending result.
number_slider_18 = Slider(4, range=0..10)
extend_curve_3 = ExtendCurve(Curve=line_11, Type=0, Start=number_slider_17, End="0")
# It's important to realize that there isn't just one methon for using recursion to solve a problem.
# Here's another version of the factorial recursion that uses fewer lines of code.
number_slider_19 = Slider(6, range=0..10)
# Eliminating tail call recursion
# Each call consumes memory.
# You can eliminate tail calls from your recursive routines.
# The simplest approach to take when you want to eliminate recursion is to create an interative alternative.
# A while loop replaces the recursive call,
# but your sill need to check for the same condition and continue looping until the data meets the condition.
number_slider_20 = Slider(6, range=0..10)
curve_curve_2 = CurveCurve(CurveA=extend_curve, CurveB=extend_curve_2)  # -> Points, ParamsA, ParamsB
panel_53 = Panel(area_2.Area)
vector_display_11 = VectorDisplay(Anchor=end_points.Start, Vector=vector_2pt_8.Vector)
panel_54 = Panel(area.Area)
text_tag_3d_6 = TextTag3D(Location=move_3.Geometry, Text="G", Size=".1", Justification=7)
text_tag_3d_7 = TextTag3D(Location=move_5.Geometry, Text="F", Size=".1", Justification=7)
text_tag_3d_8 = TextTag3D(Location=move_2.Geometry, Text="E", Size=".1", Justification=7)
factorial = Factorial(Number=number_slider_18)
move_6 = Move(Geometry=curve_curve_2.Points, Motion=vector_2pt_8.Vector)  # -> Geometry, Transform
ghpython_script_19 = GhPythonScript(n=number_slider_18)  # -> out, a; inputs n: Int32
# ---------- ghpython_script_19: Python ----------
__author__ = "Sculpture"
__version__ = "2022.06.02"

import rhinoscriptsyntax as rs

def factorial(n):
    print('factorial called with n = ' + str(n))
    if n == 1 or n == 0:
        print('Ending condition met. ')
        return 1
    else:
        return n * factorial(n-1)
        
print(factorial(n))

#a = factorial(n)
# ---------- end ghpython_script_19 ----------
ghpython_script_20 = GhPythonScript(n=number_slider_19)  # -> out, a; inputs n: Int32
# ---------- ghpython_script_20: Python ----------
__author__ = "Sculpture"
__version__ = "2022.06.02"

import rhinoscriptsyntax as rs

def factorial(n):
    print("factorial called with n = " + str(n))
    if n > 1:
        return n * factorial(n-1)
    print("Ending condition met.")
    return 1


print(factorial(n))
# ---------- end ghpython_script_20 ----------
ghpython_script_21 = GhPythonScript(n=number_slider_20)  # -> out, a; inputs n: Int32
# ---------- ghpython_script_21: Python ----------
__author__ = "Sculpture"
__version__ = "2022.06.02"

import rhinoscriptsyntax as rs

def factorial(n):
    print("factorial called with n = " + str(n))
    result = 1
    while n > 1:
        result = result * n
        n = n - 1
        print("Current value of n is " + str(n))
    print("Ending condition met.")
    return result


print(factorial(n))
# ---------- end ghpython_script_21 ----------
panel_55 = Panel(ghpython_script_19.out)
panel_56 = Panel(ghpython_script_20.out)
panel_57 = Panel(ghpython_script_21.out)
line_16 = Line(StartPoint=curve_curve_2.Points, EndPoint=move_6.Geometry)
panel_58 = Panel(factorial)
curve_curve_3 = CurveCurve(CurveA=line_16, CurveB=extend_curve_3)  # -> Points, ParamsA, ParamsB
text_tag_3d_9 = TextTag3D(Location=curve_curve_3.Points, Text="M", Size=".1", Justification=7)
text_tag_3d_10 = TextTag3D(Location=curve_curve_2.Points, Text="K", Size=".1", Justification=7)
text_tag_3d_11 = TextTag3D(Location=move_6.Geometry, Text="L", Size=".1", Justification=7)
line_17 = Line(StartPoint=curve_curve.Points, EndPoint=end_points.Start)
line_18 = Line(StartPoint=curve_curve.Points, EndPoint=move_6.Geometry)
line_19 = Line(StartPoint=curve_curve_3.Points, EndPoint=move_6.Geometry)
line_20 = Line(StartPoint=curve_curve_3.Points, EndPoint=end_points.Start)
# Performing Tasks More Quickly
# 
# Considering divide and conquer
# 
# 1. split the content in question in half.
# 2. Compare the keys for the content with the serach term.
# 3. Choose the half that contains the key.
# 4. Repeat Steps 1 through 3 until you find the key.
# 
# Binary serach that assumes you have a sorted list.
number_slider_21 = Slider(100, range=0..100)
number_slider_22 = Slider(5, range=0..10)
join_curves_3 = JoinCurves(Curves=flatten([line_18, line_19, line_20, line_17]), Preserve=False)
boundary_surfaces_3 = BoundarySurfaces(Edges=join_curves_3)
merge = Merge(Data1=boundary_surfaces_2, Data2=boundary_surfaces_3)  # -> graft(Result)
orient = Orient(Geometry=merge, Source=PlaneXY(0, 0, 0), Target=flatten(square.Points))  # -> Geometry, Transform
area_3 = Area(Geometry=orient.Geometry)  # -> Area, Centroid
rotate_3d = Rotate3D(
    Geometry=flatten(orient.Geometry),
    Angle=flatten(division),
    Center=flatten(area_3.Centroid),
    Axis=flatten(Vector(0, 0, 1)))  # -> Geometry, Transform
dispatch = Dispatch(List=rotate_3d.Geometry, DispatchPattern=[True, False])  # -> ListA, ListB
geometry = Geometry(dispatch.ListA)
geometry_2 = Geometry(dispatch.ListB)
move_7 = Move(Geometry=geometry, Motion=flatten(vector_xyz.Vector))  # -> Geometry, Transform
move_8 = Move(Geometry=flatten(geometry_2), Motion=flatten(vector_xyz.Vector))  # -> Geometry, Transform
flip_matrix = FlipMatrix(Data=move_7.Geometry)
flip_matrix_2 = FlipMatrix(Data=move_8.Geometry)
dispatch_2 = Dispatch(List=move_8.Geometry, DispatchPattern=[True, False])  # -> ListA, ListB
dispatch_3 = Dispatch(List=move_7.Geometry, DispatchPattern=[True, False])  # -> ListA, ListB
deconstruct_brep = DeconstructBrep(Brep=dispatch_2.ListB)  # -> Faces, Edges, Vertices
deconstruct_brep_2 = DeconstructBrep(Brep=dispatch_3.ListB)  # -> Faces, Edges, Vertices
deconstruct_brep_3 = DeconstructBrep(Brep=dispatch_2.ListA)  # -> Faces, Edges, Vertices
deconstruct_brep_4 = DeconstructBrep(Brep=dispatch_3.ListA)  # -> Faces, Edges, Vertices
flip_matrix_3 = FlipMatrix(Data=deconstruct_brep_3.Edges)
flip_matrix_4 = FlipMatrix(Data=deconstruct_brep_4.Edges)
flip_matrix_5 = FlipMatrix(Data=deconstruct_brep.Edges)
flip_matrix_6 = FlipMatrix(Data=deconstruct_brep_2.Edges)
join_curves_4 = JoinCurves(Curves=flip_matrix_3, Preserve=False)
join_curves_5 = JoinCurves(Curves=flip_matrix_4, Preserve=False)
join_curves_6 = JoinCurves(Curves=flip_matrix_5, Preserve=False)
join_curves_7 = JoinCurves(Curves=flip_matrix_6, Preserve=False)
loft = Loft(Curves=join_curves_6, Options={Adjust=False, Closed=False, LoftEnds=0, LoftSimp=0, LoftType=0, Rebuild=10, Refit=0.01})
loft_2 = Loft(Curves=join_curves_7, Options={Adjust=False, Closed=False, LoftEnds=0, LoftSimp=0, LoftType=0, Rebuild=10, Refit=0.01})
loft_3 = Loft(Curves=join_curves_4, Options={Adjust=False, Closed=False, LoftEnds=0, LoftSimp=0, LoftType=0, Rebuild=10, Refit=0.01})
loft_4 = Loft(Curves=join_curves_5, Options={Adjust=False, Closed=False, LoftEnds=0, LoftSimp=0, LoftType=0, Rebuild=10, Refit=0.01})
ghpython_script_22 = GhPythonScript(count=number_slider_21, num=Slider(49, range=0..100))  # -> out, count, num; inputs count: Int32, num: Int32
# ---------- ghpython_script_22: Python ----------
__author__ = "Sculpture"
__version__ = "2022.06.04"

import rhinoscriptsyntax as rs


def search(searchList, key):
    mid = int(len(searchList)/2)
    print("Searching midpoint at " + str(searchList[mid]))
    
    
    if mid == 0:
        print("Key Not Found!")
        return key
    
    elif key == searchList[mid]:
        print("Key Found!")
        return searchList[mid]
        
    elif key >= searchList[mid]:
        print("searchList now contains "+ str(searchList[mid:len(searchList)]))
        search(searchList[mid:len(searchList)], key)
        
    else:
        print("searchList now contains "+ str(searchList[0:mid]))
        search(searchList[0:mid], key)

aList = list(range(1, count))
search(aList, num)
# ---------- end ghpython_script_22 ----------
area_4 = Area(Geometry=boundary_surfaces_3)  # -> Area, Centroid
panel_59 = Panel(ghpython_script_22.out)
panel_60 = Panel(ghpython_script_22.count)
panel_61 = Panel(ghpython_script_22.num)
panel_62 = Panel(area_4.Area)
panel_63 = Panel([panel_54, panel_53, panel_62])

# ==== cluster GHPythonRemote: Connects the Grasshopper Python component to an external Python instance.
python = PythonScript()  # -> gh_parent_doc_dir
# ---------- python: Python ----------
from os import path

gh_parent_doc_dir = path.abspath(path.dirname(ghenv.Component.OnPingDocument().Owner.OnPingDocument().FilePath))
# ---------- end python ----------
# GH to python remote example.
# Pierre Cuvilliers, 2017-2018
# Released under the MIT license
# github.com/pilcru/ghpythonremote
# Runs and connects to an external python engine, and
# assigns imported modules to scriptcontext.sticky variables.
# 
# Arguments:
#       code (str): Path to the GH_to_python_sticky.py code file.
#       location (str): Path to a python executable, or to a folder
#             containing `python.exe`, or the name of a conda-created
#             virtual environment prefixed by `conda://` (`conda://env_name`).
#             If empty, finds python from your windows %PATH%.
#       run (boolean): Creates the connection, and imports new
#             modules, when turned to True. Kills the connection,
#             and deletes the references to the imports, when turned
#             to False.
#       modules (str list): List of module names to import in the
#             remote python. They will be added to the
#             scriptcontext.sticky dictionary, allowing them to be
#             reused from other python components in the same
#             Grasshopper document. Submodules (for example
#             `numpy.linalg` have to be added explicitly to this list
#             to be available later.
#       log_level (str from ['NOTSET', 'DEBUG', 'INFO', 'WARNING', 'ERROR', 'CRITICAL']):
#             Logging level to use for the local IronPython and the
#             remote python instance.
#       working_dir (str): Working directory for the remote python
#             instance.
# 
# Returns:
#       out (str): Console output with DEBUG information.
#       linked_modules (str list): list of imported module names.
#       rpy (rpyc connection object): The object representing the
#             remote Python interpreter.
location = ClusterInput()  # location (str): Path to a python executable, or to a folder containing `python.exe`, or the name of a conda-created virtual environment prefixed by `conda://` (`conda://env_name`). If empty, finds python from your windows %PATH%.
run = ClusterInput()  # run (boolean): Creates the connection, and imports new modules, when turned to True. Kills the connection,and deletes the references to the imports, when turned to False.
modules = ClusterInput()  # modules (str list): List of module names to import in the remote python. They will be added to the scriptcontext.sticky dictionary, allowing them to be reused from other python components in the same Grasshopper document. Submodules (for example `numpy.linalg` have to be added explicitly to this list to be available later.
list = ValueList({"CRITICAL", "ERROR", "WARNING", "INFO", "DEBUG", "NOTSET"}, selected="DEBUG")
panel = Panel(python)
ghpythonremote = GHPythonRemote(location=location, run=run, modules=modules, log_level=list, working_dir=panel)  # -> out, linked_modules, rpy; inputs run: Boolean, modules: list
# ---------- ghpythonremote: Python ----------
import inspect
import logging
from os import path
import sys
from time import sleep

import scriptcontext

import ghpythonremote
from ghpythonremote.connectors import GrasshopperToPythonRemote

local_log_level = getattr(logging, log_level, logging.WARNING)
logger = logging.getLogger("ghpythonremote")
logger.setLevel(local_log_level)
ch = logging.StreamHandler()
ch.setLevel(local_log_level)
formatter = logging.Formatter("%(levelname)s: %(name)s:\n%(message)s")
ch.setFormatter(formatter)
logger.handlers = []
logger.addHandler(ch)
logger = logging.getLogger("ghpythonremote.GH_to_python")

ROOT = path.abspath(path.dirname(inspect.getfile(ghpythonremote)))
rpyc_server_py = path.join(ROOT, "pythonservice.py")

# Set connection to CLOSED if this is the first run
# and initialize set of linked modules
try:
    remote_python_status
except NameError:
    remote_python_status = "CLOSED"
    lkd_modules = set()

# Wait for connection to connect or terminate
timer = 0
while remote_python_status == "CONNECTING" or remote_python_status == "CLOSING":
    sleep(1)
    timer += 1
    if timer == 10:
        try:
            gh2py_manager.__exit__(*sys.exc_info())
        except Exception:
            pass
        remote_python_status = "CLOSED"
        lkd_modules = set()
        raise RuntimeError(
            "Connection left in an inconsistent state and not returning. Reset "
            "everything."
        )

if run:
    if not remote_python_status == "OPEN":
        remote_python_status = "CONNECTING"
        gh2py_manager = GrasshopperToPythonRemote(
            rpyc_server_py,
            location=location,
            timeout=10,
            port=None,
            log_level=log_level,
            working_dir=working_dir,
        )
        gh2py = gh2py_manager.__enter__()
        remote_python_status = "OPEN"

    # Stuff that we can reach
    rpymod = gh2py.py_remote_modules  # A getter function for a named python module
    rpy = gh2py.connection  # Represents the remote instance root object
    scriptcontext.sticky["rpy"] = rpy
    # Add modules
    for mod in modules:
        try:
            scriptcontext.sticky[mod] = rpymod(mod)
            lkd_modules.add(mod)
        except ImportError:
            gh2py_manager.__exit__(*sys.exc_info())
            raise

elif not remote_python_status == "CLOSED":
    remote_python_status = "CLOSING"
    # Remove linked modules
    for mod in lkd_modules:
        del scriptcontext.sticky[mod]
    del scriptcontext.sticky["rpy"]
    gh2py_manager.__exit__(*sys.exc_info())
    lkd_modules = set()
    remote_python_status = "CLOSED"

# Change variable name because ghpython resets outputs to None before each run
linked_modules = lkd_modules

logger.info("GH to python connection is {}".format(remote_python_status))
# ---------- end ghpythonremote ----------
out = ClusterOutput(ghpythonremote.out)  # Console output.
linked_modules = ClusterOutput(ghpythonremote.linked_modules)  # Names of modules that were successfully added to the scriptcontext.sticky dictionary.
rpy = ClusterOutput(ghpythonremote.rpy)  # The object representing the remote python instance
python_2 = PythonScript(module_names=ghpythonremote.linked_modules)  # -> import_statements; inputs module_names: list
# ---------- python_2: Python ----------
import_statements = ["import scriptcontext as sc"]
for module_name in module_names:
    import_statements.append("{0} = sc.sticky['{0}']".format(module_name))

if len(module_names) == 0:
    import_statements = []
# ---------- end python_2 ----------
import_statements = ClusterOutput(python_2)  # Useful import statements to use the imported modules in your scripts.
